vi "index.gviweb"   [LabVIEW NXG 3.1.0]
panel indicators:
  "Graph": T1
  "Tank": f64
  "Tank_2": f64
  "Tank_3": f64
  "Tank_4": f64
  "Tank_5": f64
  "Tank_6": f64
types:
  T1 = cluster{"2523-5": f64, "2523-14": f64, "2523-23": f64, "2523-32": f64, "2523-41": f64, "2523-50": f64}
uses:
  Widgets::jsli::Extensions.jsli::GetParameterByName
  NI::HTTP::POST Buffer.gvi
  NI::HTTP::GET.gvi
diagram:
  call "GetParameterByName"(name="interval") -> (return=w1)
  Scan From String(formatString="%d", inputString=w1, default=1000) -> (out0=w2)
  w3 = """{
    "Name": "request",
    "DataItems": [
        {
            "assetId": "2523",
            "dataItemId": 5
        },
        {
            "assetId": "2523",
            "dataItemId": 14
        },
        {
            "assetId": "2523",
            "dataItemId": 23
        },
        {
            "assetId": "2523",
            "dataItemId": 32
        },
        {
            "assetId": "2523",
            "dataItemId": 41
        },
        {
            "assetId": "2523",
            "dataItemId": 50
        }
    ],
    "StartTime": "%s",
    "EndTime": "%s",
    "Format": {
        "Type": "DataItemChart"
    }
}"""
  Get Current Time() -> (current time=w4)
  Format Date Time String(UTC format=TRUE, time stamp=w4) -> (date/time string=w5)
  call "GetParameterByName"(name="length") -> (return=w6)
  Scan From String(formatString="%f", inputString=w6, default=3600) -> (out0=w7)
  Time Stamp Subtract(x=w4, y=w7) -> w8
  Format Date Time String(UTC format=TRUE, time stamp=w8) -> (date/time string=w9)
  Format Into String(formatString=w3, w9, w5) -> w10
  call "POST Buffer.gvi"(url="/api/historicaldataitems", buffer=w10) -> (body=w11)
  Unflatten From JSON(JSON string=w11, type and defaults=T1[] []) -> (value=w12)
  for {
    w13 = each element of w12
    $Graph <- w13
  }
  while (after w13) {
    Wait Until Next Multiple(multiple to wait=w2)
    w14 = cluster{"dataItemId": i32, "value": f64}[] [{"dataItemId"=0, "value"=0}]
    call "GET.gvi"(url="/api/assets/2523/currentdataitems") -> (body=w15)
    Unflatten From JSON(JSON string=w15, type and defaults=w14) -> (value=w16)
    s1 = T1 {all zero or empty}  # shift register
    for {
      w17 = each element of w16
      Property Node(instance in=w17) -> ("dataItemId"=w18, "value"=w19)
      case (w18) {
        frame 0, Default {
          w20 = s1
        }
        frame 5 {
          $Tank <- w19
          Property Node(instance in=s1, "2523-5"=w19) -> (instance out=w20)
        }
        frame 14 {
          $Tank_2 <- w19
          Property Node(instance in=s1, "2523-14"=w19) -> (instance out=w20)
        }
        frame 23 {
          $Tank_3 <- w19
          Property Node(instance in=s1, "2523-23"=w19) -> (instance out=w20)
        }
        frame 32 {
          $Tank_4 <- w19
          Property Node(instance in=s1, "2523-32"=w19) -> (instance out=w20)
        }
        frame 41 {
          $Tank_5 <- w19
          Property Node(instance in=s1, "2523-41"=w19) -> (instance out=w20)
        }
        frame 50 {
          $Tank_6 <- w19
          Property Node(instance in=s1, "2523-50"=w19) -> (instance out=w20)
        }
      }
      next s1 = w20
    }
    $Graph <- s1
    stop if FALSE
  }
  call "GetParameterByName"(name="count") -> (return=w21)
  Scan From String(formatString="%d", inputString=w21, default=3600) -> (out0=w22)
  s2 = 0  # shift register
  s3 = 0  # shift register
  s4 = 0  # shift register
  for (N = w22) {
    Random Number() -> (number (0 to 1)=w23)
    Add(w23, -0.5) -> w24
    Multiply(w24, 5000) -> w25
    Add(w25, s2) -> w26
    Random Number() -> (number (0 to 1)=w27)
    Add(w27, -0.5) -> w28
    Multiply(w28, 5000) -> w29
    Add(w29, s3) -> w30
    Random Number() -> (number (0 to 1)=w31)
    Add(w31, -0.5) -> w32
    Multiply(w32, 5000) -> w33
    Add(w33, s4) -> w34
    Build Array(w26, w30, w34)
    Random Number()
    Random Number()
    next s2 = w26
    next s3 = w30
    next s4 = w34
  }
  disable {
    frame Enabled { }
    frame Disabled {
      s5 = s2  # shift register
      s6 = s3  # shift register
      s7 = s4  # shift register
      while {
        Random Number() -> (number (0 to 1)=w35)
        Add(w35, -0.5) -> w36
        Multiply(w36, 5000) -> w37
        Add(w37, s5) -> w38
        Random Number() -> (number (0 to 1)=w39)
        Add(w39, -0.5) -> w40
        Multiply(w40, 5000) -> w41
        Add(w41, s6) -> w42
        Random Number() -> (number (0 to 1)=w43)
        Add(w43, -0.5) -> w44
        Multiply(w44, 5000) -> w45
        Add(w45, s7) -> w46
        Build Array(w38, w42, w46)
        next s5 = w38
        next s6 = w42
        next s7 = w46
        stop if FALSE
      }
    }
  }
